# Dynamo custom node SurfacePlacingLighting.dyf (Dynamo 2.12.1.8246)
# category: DynaTools
# This node inserts the light fixture on a selected face of Revit (ceiling) according to the general lighting spacing criteria, where the space L between the fixture and the wall and 2L between fixtures is defined, maintaining an even distribution. The user must select the necessary divisions on each side until reaching the desired configuration.

Familytype = Input(Familytype: Revit.Elements.FamilyType)
CeilingSurface = Input(CeilingSurface: Autodesk.DesignScript.Geometry.Surface)
code_block = CodeBlock(face=CeilingSurface) { curve1 = Surface.GetIsoline(face, 0, 0); curve2 = Surface.GetIsoline(face, 1, 0); }
Division_X = Input(Division_X: var[]..[])
Division_Y = Input(Division_Y: var[]..[])
python_script = Python(IN[0]=code_block.curve1, IN[1]=code_block.curve2, IN[2]=Division_X, IN[3]=Division_Y)  # IronPython2
# ---------- python_script.python (65 lines) ----------
import clr
clr.AddReference('ProtoGeometry')
from Autodesk.DesignScript.Geometry import *

# Developed by Paulo Augusto Giavoni
# Contact: paulo.giavoni@gmail.com
# LinkedIn: https://www.linkedin.com/in/paulogiavoni/

# Inputs
curve1 = IN[0]  # First curve (horizontal)
curve2 = IN[1]  # Second curve (vertical)
divisions1 = IN[2]  # Number of internal divisions for the first curve
divisions2 = IN[3]  # Number of internal divisions for the second curve

def get_curve(curve):
    """Ensure the input is a single curve."""
    if isinstance(curve, list):
        return curve[0]
    return curve

def get_points(curve, divisions, margin=1):
    """Generate points along the curve, considering margins and spacing rules."""
    points = []
    total_divisions = (divisions - 1) * 2 + margin * 2  # Calculate total divisions considering margins
    for i in range(total_divisions + 1):
        param = i / float(total_divisions)
        point = curve.PointAtParameter(param)
        # Add points within the margin and following the spacing rule
        if margin <= i <= total_divisions - margin:
            if (i - margin) % 2 == 0:
                points.append(point)
    return points

def find_intersections(points1, points2):
    """Find intersection points based on X and Y coordinates of points from two curves."""
    intersections = []
    for pt1 in points1:
        for pt2 in points2:
            intersection_point = Point.ByCoordinates(pt1.X, pt2.Y, pt1.Z)
            intersections.append(intersection_point)
    return intersections

# Verify input curves
curve1 = get_curve(curve1)
curve2 = get_curve(curve2)

# Validate division inputs
error_message = None
if divisions1 <= 0 or divisions2 <= 0:
    error_message = "Error: The number of divisions must be greater than 0."
elif divisions1 < 0 or divisions2 < 0:
    error_message = "Error: The number of divisions cannot be negative."

if error_message:
    OUT = [error_message]
else:
    # Obtain points along the curves
    pointsCurve1 = get_points(curve1, divisions1)
    pointsCurve2 = get_points(curve2, divisions2)

    # Find intersection points
    intersectionPoints = find_intersections(pointsCurve1, pointsCurve2)

    # Output
    OUT = intersectionPoints
# ----------------------------------------
code_block_2 = CodeBlock(familyinstance=Familytype, t2=python_script) { familyinstance1 = FamilyInstance.ByPoint(familyinstance, t2); }
python_script_2 = Python(IN[0]=code_block_2, IN[1]=python_script)  # IronPython2; graph output
# ---------- python_script_2.python (16 lines) ----------
# Load the Python Standard and DesignScript Libraries
import sys
import clr
clr.AddReference('ProtoGeometry')
from Autodesk.DesignScript.Geometry import *

# The inputs to this node will be stored as a list in the IN variables.
familyinstance = IN[0]
points = IN[1]

# Check for null inputs
if familyinstance is None or points is None:
    OUT = "Error: One or more inputs are null."
else:
    # Format the output as a list with titles
    OUT = ("Family Instance", familyinstance), ("Points", points)
# ----------------------------------------
