# Dynamo graph Autodesk.DesignScript.Geometry.Arc.ByFilletTangentToCurve.dyn "ByFilletTangentToCurve" (Dynamo 2.0.1.5055)

code_block = CodeBlock { 0; 5; 5; }
byCoordinates = Point.ByCoordinates(x=code_block.out0, y=code_block.out1)
byCoordinates_2 = Point.ByCoordinates(x=code_block.out1, y=code_block.out2)
byStartPointEndPoint = Line.ByStartPointEndPoint(startPoint=byCoordinates, endPoint=byCoordinates_2)
number_slider = DoubleSlider(0.8, range=0..3 step 0.1)  # graph input
byCenterPointRadius = Circle.ByCenterPointRadius(centerPoint=byCoordinates_2, radius=number_slider)
byCoordinates_3 = Point.ByCoordinates(x=code_block.out2, y=code_block.out0)
byStartPointEndPoint_2 = Line.ByStartPointEndPoint(startPoint=byCoordinates_3, endPoint=byCoordinates)
byFilletTangentToCurve = Arc.ByFilletTangentToCurve(curve1=byStartPointEndPoint, curveTangentTo=byCenterPointRadius, curve2=byStartPointEndPoint_2)
