# Dynamo graph Autodesk.DesignScript.Geometry.Arc.ByStartEndAndTangencies.dyn "ByStartEndAndTangencies" (Dynamo 2.0.1.5055)

code_block = CodeBlock { 2; }
randomList = Math.RandomList(amount=code_block)
code_block_2 = CodeBlock(x=randomList) { x*12; }
randomList_2 = Math.RandomList(amount=code_block)
code_block_3 = CodeBlock(x=randomList_2) { x*12; }
byCoordinates = Point.ByCoordinates(x=code_block_2, y=code_block_3)
code_block_4 = CodeBlock { 0; 1; }
getItemAtIndex = List.GetItemAtIndex(list=byCoordinates, index=code_block_4.out0)
YAxis = Vector.YAxis()
getItemAtIndex_2 = List.GetItemAtIndex(list=byCoordinates, index=code_block_4.out1)
byStartEndAndTangencies = Arc.ByStartEndAndTangencies(point1=getItemAtIndex, vector1=YAxis, point2=getItemAtIndex_2, vector2=YAxis)
