# Dynamo graph Autodesk.DesignScript.Geometry.BoundingBox.Contains.dyn "Contains" (Dynamo 2.17.0.2403)

origin = Point.Origin()
number_slider = DoubleSlider(10.1, range=0..100 step 0.1)  # graph input
byCenterPointRadius = Sphere.ByCenterPointRadius(centerPoint=origin, radius=number_slider)
byGeometry = BoundingBox.ByGeometry(geom=byCenterPointRadius)
code_block = CodeBlock { 5; 5; 5; }
byCoordinates = Point.ByCoordinates(x=code_block.out0, y=code_block.out1, z=code_block.out2)
contains = BoundingBox.Contains(boundingBox=byGeometry, point=byCoordinates)
watch = Watch(contains)
toCuboid = BoundingBox.ToCuboid(boundingBox=byGeometry)
edges = Topology.Edges(topology=toCuboid)
curveGeometry = Edge.CurveGeometry(edge=edges)
