# Dynamo graph Autodesk.DesignScript.Geometry.BoundingBox.ToCuboid.dyn "ToCuboid" (Dynamo 2.17.0.2403)

origin = Point.Origin()
number_slider = DoubleSlider(10.1, range=0..100 step 0.1)  # graph input
byCenterPointRadius = Sphere.ByCenterPointRadius(centerPoint=origin, radius=number_slider)
byGeometry = BoundingBox.ByGeometry(geom=byCenterPointRadius)
toCuboid = BoundingBox.ToCuboid(boundingBox=byGeometry)
edges = Topology.Edges(topology=toCuboid)
curveGeometry = Edge.CurveGeometry(edge=edges)
minPoint = BoundingBox.MinPoint(boundingBox=byGeometry)
maxPoint = BoundingBox.MaxPoint(boundingBox=byGeometry)
