# Dynamo graph Autodesk.DesignScript.Geometry.Circle.ByPlaneRadius.dyn "ByPlaneRadius" (Dynamo 2.0.1.5055)

YZ = Plane.YZ()
number_slider = DoubleSlider(1.5, range=0..10 step 0.1)  # graph input
byPlaneRadius = Circle.ByPlaneRadius(plane=YZ, radius=number_slider)
