# Dynamo graph Autodesk.DesignScript.Geometry.Circle.ByThreePoints.dyn "ByThreePoints" (Dynamo 2.0.1.5055)

number = DoubleInput(3)  # graph input
randomList = Math.RandomList(amount=number)
randomList_2 = Math.RandomList(amount=number)
byCoordinates = Point.ByCoordinates(x=randomList, y=randomList_2)
deconstruct = List.Deconstruct(list=byCoordinates)
deconstruct_2 = List.Deconstruct(list=deconstruct.rest)
byThreePoints = Circle.ByThreePoints(p1=deconstruct.first, p2=deconstruct_2.first, p3=deconstruct_2.rest)
