# Dynamo graph Autodesk.DesignScript.Geometry.Cone.ByCoordinateSystemHeightRadius.dyn "ByCoordinateSystemHeightRadius" (Dynamo 2.0.1.5055)

code_block = CodeBlock { 0; 0; 0; }
byCoordinates = Point.ByCoordinates(x=code_block.out0, y=code_block.out1, z=code_block.out2)
byOrigin = CoordinateSystem.ByOrigin(origin=byCoordinates)
number_slider = DoubleSlider(8.3, range=0..10 step 0.1)  # graph input
number_slider_2 = DoubleSlider(4.3, range=0..10 step 0.1)  # graph input
byCoordinateSystemHeightRadius = Cone.ByCoordinateSystemHeightRadius(cs=byOrigin, height=number_slider, startRadius=number_slider_2)
