# Dynamo graph Autodesk.DesignScript.Geometry.Cone.StartPoint.dyn "StartPoint" (Dynamo 2.0.1.5055)

code_block = CodeBlock { 0; 0; }
byOrigin = CoordinateSystem.ByOrigin(x=code_block.out0, y=code_block.out1)
number_slider = DoubleSlider(8, range=0..10 step 0.1)  # graph input
number_slider_2 = DoubleSlider(7.7, range=0..10 step 0.1)  # graph input
number_slider_3 = DoubleSlider(4.4, range=0..10 step 0.1)  # graph input
byCoordinateSystemHeightRadii = Cone.ByCoordinateSystemHeightRadii(cs=byOrigin, height=number_slider, startRadius=number_slider_2, endRadius=number_slider_3)
startPoint = Cone.StartPoint(cone=byCoordinateSystemHeightRadii)
