# Dynamo graph Autodesk.DesignScript.Geometry.CoordinateSystem.Determinant.dyn "Determinant" (Dynamo 2.0.1.5055)

number_slider = DoubleSlider(2.6, range=0..5 step 0.1)  # graph input
number_slider_2 = DoubleSlider(17.6, range=0..100 step 0.1)  # graph input
number_slider_3 = DoubleSlider(1.1, range=0..4 step 0.1)  # graph input
byCylindricalCoordinates = CoordinateSystem.ByCylindricalCoordinates(radius=number_slider, theta=number_slider_2, height=number_slider_3)
determinant = CoordinateSystem.Determinant(coordinateSystem=byCylindricalCoordinates)
watch = Watch(determinant)
