# Dynamo graph Autodesk.DesignScript.Geometry.CoordinateSystem.IsEqualTo.dyn "IsEqualTo" (Dynamo 2.0.2.6826)

byOrigin = CoordinateSystem.ByOrigin()
byOrigin_2 = CoordinateSystem.ByOrigin()
isEqualTo = CoordinateSystem.IsEqualTo(coordinateSystem=byOrigin, other=byOrigin_2)
