# Dynamo graph Autodesk.DesignScript.Geometry.CoordinateSystem.IsSingular.dyn "IsSingular" (Dynamo 2.0.1.5055)

number_slider = DoubleSlider(0.9, range=0..5 step 0.1)  # graph input
byOrigin = CoordinateSystem.ByOrigin(x=number_slider, y=number_slider, z=number_slider)
isSingular = CoordinateSystem.IsSingular(coordinateSystem=byOrigin)
watch = Watch(isSingular)
