# Dynamo graph Autodesk.DesignScript.Geometry.CoordinateSystem.IsUniscaledOrtho.dyn "IsUniscaledOrtho" (Dynamo 2.0.1.5055)

code_block = CodeBlock { 2.3; }
byCoordinates = Vector.ByCoordinates(x=code_block)
byOriginVectors = CoordinateSystem.ByOriginVectors(xAxis=byCoordinates)
isUniscaledOrtho = CoordinateSystem.IsUniscaledOrtho(coordinateSystem=byOriginVectors)
watch = Watch(isUniscaledOrtho)
