# Dynamo graph Autodesk.DesignScript.Geometry.CoordinateSystem.PreMultiplyBy.dyn "PreMultiplyBy" (Dynamo 2.0.1.5055)

code_block = CodeBlock { Point.ByCoordinates(1,2,0); Point.ByCoordinates(-2,-2,0); Vector.ByCoordinates(1,1,1); }
byOriginVectors = CoordinateSystem.ByOriginVectors(origin=code_block.out0)
byOriginVectors_2 = CoordinateSystem.ByOriginVectors(origin=code_block.out1, yAxis=code_block.out2)
preMultiplyBy = CoordinateSystem.PreMultiplyBy(coordinateSystem=byOriginVectors, other=byOriginVectors_2)
