# Dynamo graph Autodesk.DesignScript.Geometry.CoordinateSystem.Scale1D.dyn (Dynamo 2.17.0.3255)

number_slider = DoubleSlider(18.1, range=7..20 step 0.1)  # graph input
code_block = CodeBlock(x=number_slider) { Point.ByCoordinates(2,0,0); Vector.ByCoordinates(4,0,0); Point.ByCoordinates(1,2,0); Point.ByCoordinates(x,0,0); }
byOriginNormal = Plane.ByOriginNormal(origin=code_block.out0, normal=code_block.out1)
byPlane = CoordinateSystem.ByPlane(plane=byOriginNormal)
origin = Point.Origin()
scale1D = CoordinateSystem.Scale1D(coordinateSystem=byPlane, basePoint=origin, from=code_block.out2, to=code_block.out3)
watch = Watch(scale1D)
XYPlane = CoordinateSystem.XYPlane(coordinateSystem=scale1D)
code_block_2 = CodeBlock(plane1=byOriginNormal, plane2=XYPlane) { Ellipse.ByPlaneRadii([plane1,plane2],2,1); }
byLoft = Solid.ByLoft(crossSections=code_block_2)
code_block_3 = CodeBlock(geometry=byLoft) { color = Color.ByARGB(100,141,198,217); Modifiers.GeometryColor.ByGeometryColor(geometry, color); }
