# Dynamo graph Autodesk.DesignScript.Geometry.CoordinateSystem.ScaleFactor.dyn (Dynamo 1.1.0.2093)

origin = Point.Origin()
byOriginVectors = CoordinateSystem.ByOriginVectors(origin=origin)
code_block = CodeBlock { 1; }
byCoordinates = Point.ByCoordinates(x=code_block, y=code_block)
number_slider = DoubleSlider(3.5, range=0..10 step 0.1)
byCoordinates_2 = Point.ByCoordinates(x=number_slider, y=number_slider)
scale = CoordinateSystem.Scale(byOriginVectors, origin, byCoordinates, byCoordinates_2)
scaleFactor = CoordinateSystem.ScaleFactor(scale)
watch = Watch(scaleFactor)
