# Dynamo graph Autodesk.DesignScript.Geometry.CoordinateSystem.XAxis.dyn "XAxis" (Dynamo 2.0.1.5055)

code_block = CodeBlock { 2; 3; }
byOrigin = CoordinateSystem.ByOrigin(x=code_block.out0, y=code_block.out1)
XAxis = CoordinateSystem.XAxis(coordinateSystem=byOrigin)
watch = Watch(XAxis)
code_block_2 = CodeBlock { Point.ByCoordinates(2,3); 3; }
byStartPointDirectionLength = Line.ByStartPointDirectionLength(startPoint=code_block_2.out0, direction=XAxis, length=code_block_2.out1)
