# Dynamo graph Autodesk.DesignScript.Geometry.CoordinateSystem.YAxis.dyn "YAxis" (Dynamo 2.0.1.5055)

code_block = CodeBlock { 2; 3; }
byOrigin = CoordinateSystem.ByOrigin(x=code_block.out0, y=code_block.out1)
YAxis = CoordinateSystem.YAxis(coordinateSystem=byOrigin)
watch = Watch(YAxis)
code_block_2 = CodeBlock { Point.ByCoordinates(2,3); 3; }
byStartPointDirectionLength = Line.ByStartPointDirectionLength(startPoint=code_block_2.out0, direction=YAxis, length=code_block_2.out1)
