# Dynamo graph Autodesk.DesignScript.Geometry.CoordinateSystem.ZAxis.dyn "ZAxis" (Dynamo 2.0.1.5055)

origin = Point.Origin()
byOriginVectors = CoordinateSystem.ByOriginVectors(origin=origin)
code_block = CodeBlock { 1; }
byCoordinates = Vector.ByCoordinates(y=code_block)
number_slider = DoubleSlider(38.7, range=0..100 step 0.1)  # graph input
rotate = CoordinateSystem.Rotate(coordinateSystem=byOriginVectors, origin=origin, axis=byCoordinates, degrees=number_slider)
ZAxis = CoordinateSystem.ZAxis(coordinateSystem=rotate)
code_block_2 = CodeBlock { 4; }
byStartPointDirectionLength = Line.ByStartPointDirectionLength(startPoint=origin, direction=ZAxis, length=code_block_2)
