# Dynamo graph Autodesk.DesignScript.Geometry.CoordinateSystem.ZScaleFactor.dyn "ZScaleFactor" (Dynamo 2.0.1.5055)

byOrigin = CoordinateSystem.ByOrigin()
number_slider = DoubleSlider(2.3, range=0..5 step 0.1)  # graph input
scale = CoordinateSystem.Scale(coordinateSystem=byOrigin, amount=number_slider)
ZScaleFactor = CoordinateSystem.ZScaleFactor(coordinateSystem=scale)
watch = Watch(ZScaleFactor)
ZScaleFactor_2 = CoordinateSystem.ZScaleFactor(coordinateSystem=byOrigin)
watch_2 = Watch(ZScaleFactor_2)
byRadiusHeight = Cylinder.ByRadiusHeight(cs=scale)
code_block = CodeBlock(geometry=byRadiusHeight) { color = Color.ByARGB(100,141,198,217); GeometryColor.ByGeometryColor(geometry, color); }
byRadiusHeight_2 = Cylinder.ByRadiusHeight(cs=byOrigin)
code_block_2 = CodeBlock(geometry=byRadiusHeight_2) { color = Color.ByARGB(100,141,198,217); GeometryColor.ByGeometryColor(geometry, color); }
