# Dynamo graph REVIT API TEMPLATE.dyn (Dynamo 2.12.1.8246)

# note: Collect Revit Elements
# Revit's FilteredElementCollector class allows you to search for elements in the document database.
# To create an instance of this class, you have to pass the document as an argument to the constructor, and then use a set of specific filtering rules to find the desired elements.
# note: import clr #This is .NET's Common Language Runtime. It's an execution environment
# #that is able to execute code from several different languages.
# import sys #sys is a fundamental Python library - here, we're using it to load in
# #the standard IronPython libraries
# sys.path.append('C:\Program Files (x86)\IronPython 2.7\Lib') #Imports the
# #standard IronPython libraries, which cover everything from servers and
# #encryption through to regular expressions.
# import System #The System namespace at the root of .NET
# from System import Array #.NET class for handling array information
# from System.Collections.Generic import * #Lets you handle generics. Revit's API
# #sometimes wants hard-typed 'generic' lists, called ILists. If you don't need
# #these you can delete this line.
# clr.AddReference('ProtoGeometry')  #A Dynamo library for its proxy geometry
# #classes. You'll only need this if you're interacting with geometry.
# from Autodesk.DesignScript.Geometry import * #Loads everything in Dynamo's
# #geometry library
# clr.AddReference("RevitNodes") #Dynamo's nodes for Revit
# import Revit #Loads in the Revit namespace in RevitNodes
# clr.ImportExtensions(Revit.Elements) #More loading of Dynamo's Revit libraries
# clr.ImportExtensions(Revit.GeometryConversion) #More loading of Dynamo's
# #Revit libraries. You'll only need this if you're interacting with geometry.
# clr.AddReference("RevitServices") #Dynamo's classes for handling Revit documents
# import RevitServices
# from RevitServices.Persistence import DocumentManager #An internal Dynamo class
# #that keeps track of the document that Dynamo is currently attached to
# from RevitServices.Transactions import TransactionManager #A Dynamo class for
# #opening and closing transactions to change the Revit document's database
# clr.AddReference("RevitAPI") #Adding reference to Revit's API DLLs
# clr.AddReference("RevitAPIUI") #Adding reference to Revit's API DLLs
# import Autodesk #Loads the Autodesk namespace
# from Autodesk.Revit.DB import * #Loading Revit's API classes
# from Autodesk.Revit.UI import * #Loading Revit's API UI classes
# doc = DocumentManager.Instance.CurrentDBDocument #Finally, setting up handles to the active Revit document
# uiapp = DocumentManager.Instance.CurrentUIApplication #Setting a handle to the active Revit UI document
# app = uiapp.Application  #Setting a handle to the currently-open instance of the Revit application
# uidoc = uiapp.ActiveUIDocument #Setting a handle to the currently-open instance of the Revit UI application
# #######OK NOW YOU CAN CODE########
# note: OST = Object STtyle
# OST_ + Category Name
actual_document_description = Python()  # IronPython2; unwired: IN[0]
# ---------- actual_document_description.python (65 lines) ----------
import clr #This is .NET's Common Language Runtime. It's an execution environment
#that is able to execute code from several different languages.
import sys #sys is a fundamental Python library - here, we're using it to load in
#the standard IronPython libraries
sys.path.append('C:\Program Files (x86)\IronPython 2.7\Lib') #Imports the
#standard IronPython libraries, which cover everything from servers and
#encryption through to regular expressions.
import System #The System namespace at the root of .NET
from System import Array #.NET class for handling array information
from System.Collections.Generic import * #Lets you handle generics. Revit's API
#sometimes wants hard-typed 'generic' lists, called ILists. If you don't need
#these you can delete this line.
clr.AddReference('ProtoGeometry')  #A Dynamo library for its proxy geometry
#classes. You'll only need this if you're interacting with geometry.
from Autodesk.DesignScript.Geometry import * #Loads everything in Dynamo's
#geometry library
clr.AddReference("RevitNodes") #Dynamo's nodes for Revit
import Revit #Loads in the Revit namespace in RevitNodes
clr.ImportExtensions(Revit.Elements) #More loading of Dynamo's Revit libraries
clr.ImportExtensions(Revit.GeometryConversion) #More loading of Dynamo's
#Revit libraries. You'll only need this if you're interacting with geometry.
clr.AddReference("RevitServices") #Dynamo's classes for handling Revit documents
import RevitServices 
from RevitServices.Persistence import DocumentManager #An internal Dynamo class
#that keeps track of the document that Dynamo is currently attached to
from RevitServices.Transactions import TransactionManager #A Dynamo class for
#opening and closing transactions to change the Revit document's database

clr.AddReference("RevitAPI") #Adding reference to Revit's API DLLs
clr.AddReference("RevitAPIUI") #Adding reference to Revit's API DLLs

import Autodesk #Loads the Autodesk namespace
from Autodesk.Revit.DB import * #Loading Revit's API classes
from Autodesk.Revit.UI import * #Loading Revit's API UI classes  

doc = DocumentManager.Instance.CurrentDBDocument #Finally, setting up handles to the active Revit document
uiapp = DocumentManager.Instance.CurrentUIApplication #Setting a handle to the active Revit UI document
app = uiapp.Application  #Setting a handle to the currently-open instance of the Revit application
uidoc = uiapp.ActiveUIDocument #Setting a handle to the currently-open instance of the Revit UI application

#######OK NOW YOU CAN CODE########


app = doc.Application
version_number = app.VersionNumber
version_name = app.VersionName
version = app.VersionNumber
name = app.VersionName
build = app.VersionBuild
sub_version_number = app.SubVersionNumber
product = app.Product
language = app.Language
folder = app.CurrentUsersDataFolderPath

OUT = (
    "Version Number: {}".format(version_number),
    "Version Name: {}".format(version_name),
    "Version: {}".format(version),
    "Name: {}".format(name),
    "Build: {}".format(build),
    "Sub Version Number: {}".format(sub_version_number),
    "Product: {}".format(product),
    "Language: {}".format(language),
    "Folder: {}".format(folder)
)
# ----------------------------------------
collector_activeview = Python()  # IronPython2; frozen; unwired: IN[0]
# ---------- collector_activeview.python (45 lines) ----------
import clr #This is .NET's Common Language Runtime. It's an execution environment
#that is able to execute code from several different languages.
import sys #sys is a fundamental Python library - here, we're using it to load in
#the standard IronPython libraries
sys.path.append('C:\Program Files (x86)\IronPython 2.7\Lib') #Imports the
#standard IronPython libraries, which cover everything from servers and
#encryption through to regular expressions.
import System #The System namespace at the root of .NET
from System import Array #.NET class for handling array information
from System.Collections.Generic import * #Lets you handle generics. Revit's API
#sometimes wants hard-typed 'generic' lists, called ILists. If you don't need
#these you can delete this line.
clr.AddReference('ProtoGeometry')  #A Dynamo library for its proxy geometry
#classes. You'll only need this if you're interacting with geometry.
from Autodesk.DesignScript.Geometry import * #Loads everything in Dynamo's
#geometry library
clr.AddReference("RevitNodes") #Dynamo's nodes for Revit
import Revit #Loads in the Revit namespace in RevitNodes
clr.ImportExtensions(Revit.Elements) #More loading of Dynamo's Revit libraries
clr.ImportExtensions(Revit.GeometryConversion) #More loading of Dynamo's
#Revit libraries. You'll only need this if you're interacting with geometry.
clr.AddReference("RevitServices") #Dynamo's classes for handling Revit documents
import RevitServices 
from RevitServices.Persistence import DocumentManager #An internal Dynamo class
#that keeps track of the document that Dynamo is currently attached to
from RevitServices.Transactions import TransactionManager #A Dynamo class for
#opening and closing transactions to change the Revit document's database

clr.AddReference("RevitAPI") #Adding reference to Revit's API DLLs
clr.AddReference("RevitAPIUI") #Adding reference to Revit's API DLLs

import Autodesk #Loads the Autodesk namespace
from Autodesk.Revit.DB import * #Loading Revit's API classes
from Autodesk.Revit.UI import * #Loading Revit's API UI classes  

doc = DocumentManager.Instance.CurrentDBDocument #Finally, setting up handles to the active Revit document
uiapp = DocumentManager.Instance.CurrentUIApplication #Setting a handle to the active Revit UI document
app = uiapp.Application  #Setting a handle to the currently-open instance of the Revit application
uidoc = uiapp.ActiveUIDocument #Setting a handle to the currently-open instance of the Revit UI application

#######OK NOW YOU CAN CODE########

collector = FilteredElementCollector(doc, doc.ActiveView.Id)

OUT = collector
# ----------------------------------------
views = Views("Section Perspective")
collector_specificview_id = Python(IN[0]=views)  # IronPython2; frozen
# ---------- collector_specificview_id.python (46 lines) ----------
import clr #This is .NET's Common Language Runtime. It's an execution environment
#that is able to execute code from several different languages.
import sys #sys is a fundamental Python library - here, we're using it to load in
#the standard IronPython libraries
sys.path.append('C:\Program Files (x86)\IronPython 2.7\Lib') #Imports the
#standard IronPython libraries, which cover everything from servers and
#encryption through to regular expressions.
import System #The System namespace at the root of .NET
from System import Array #.NET class for handling array information
from System.Collections.Generic import * #Lets you handle generics. Revit's API
#sometimes wants hard-typed 'generic' lists, called ILists. If you don't need
#these you can delete this line.
clr.AddReference('ProtoGeometry')  #A Dynamo library for its proxy geometry
#classes. You'll only need this if you're interacting with geometry.
from Autodesk.DesignScript.Geometry import * #Loads everything in Dynamo's
#geometry library
clr.AddReference("RevitNodes") #Dynamo's nodes for Revit
import Revit #Loads in the Revit namespace in RevitNodes
clr.ImportExtensions(Revit.Elements) #More loading of Dynamo's Revit libraries
clr.ImportExtensions(Revit.GeometryConversion) #More loading of Dynamo's
#Revit libraries. You'll only need this if you're interacting with geometry.
clr.AddReference("RevitServices") #Dynamo's classes for handling Revit documents
import RevitServices 
from RevitServices.Persistence import DocumentManager #An internal Dynamo class
#that keeps track of the document that Dynamo is currently attached to
from RevitServices.Transactions import TransactionManager #A Dynamo class for
#opening and closing transactions to change the Revit document's database

clr.AddReference("RevitAPI") #Adding reference to Revit's API DLLs
clr.AddReference("RevitAPIUI") #Adding reference to Revit's API DLLs

import Autodesk #Loads the Autodesk namespace
from Autodesk.Revit.DB import * #Loading Revit's API classes
from Autodesk.Revit.UI import * #Loading Revit's API UI classes  

doc = DocumentManager.Instance.CurrentDBDocument #Finally, setting up handles to the active Revit document
uiapp = DocumentManager.Instance.CurrentUIApplication #Setting a handle to the active Revit UI document
app = uiapp.Application  #Setting a handle to the currently-open instance of the Revit application
uidoc = uiapp.ActiveUIDocument #Setting a handle to the currently-open instance of the Revit UI application

#######OK NOW YOU CAN CODE########
specificView = UnwrapElement(IN[0])

collector = FilteredElementCollector(doc, specificView.Id)

OUT = collector
# ----------------------------------------
categories = Categories("OST_Walls")
filter_elements_by_categoryid = Python(IN[0]=categories)  # IronPython2; frozen
# ---------- filter_elements_by_categoryid.python (53 lines) ----------
import clr #This is .NET's Common Language Runtime. It's an execution environment
#that is able to execute code from several different languages.
import sys #sys is a fundamental Python library - here, we're using it to load in
#the standard IronPython libraries
sys.path.append('C:\Program Files (x86)\IronPython 2.7\Lib') #Imports the
#standard IronPython libraries, which cover everything from servers and
#encryption through to regular expressions.
import System #The System namespace at the root of .NET
from System import Array #.NET class for handling array information
from System.Collections.Generic import * #Lets you handle generics. Revit's API
#sometimes wants hard-typed 'generic' lists, called ILists. If you don't need
#these you can delete this line.
clr.AddReference('ProtoGeometry')  #A Dynamo library for its proxy geometry
#classes. You'll only need this if you're interacting with geometry.
from Autodesk.DesignScript.Geometry import * #Loads everything in Dynamo's
#geometry library
clr.AddReference("RevitNodes") #Dynamo's nodes for Revit
import Revit #Loads in the Revit namespace in RevitNodes
clr.ImportExtensions(Revit.Elements) #More loading of Dynamo's Revit libraries
clr.ImportExtensions(Revit.GeometryConversion) #More loading of Dynamo's
#Revit libraries. You'll only need this if you're interacting with geometry.
clr.AddReference("RevitServices") #Dynamo's classes for handling Revit documents
import RevitServices 
from RevitServices.Persistence import DocumentManager #An internal Dynamo class
#that keeps track of the document that Dynamo is currently attached to
from RevitServices.Transactions import TransactionManager #A Dynamo class for
#opening and closing transactions to change the Revit document's database

clr.AddReference("RevitAPI") #Adding reference to Revit's API DLLs
clr.AddReference("RevitAPIUI") #Adding reference to Revit's API DLLs

import Autodesk #Loads the Autodesk namespace
from Autodesk.Revit.DB import * #Loading Revit's API classes
from Autodesk.Revit.UI import * #Loading Revit's API UI classes  

doc = DocumentManager.Instance.CurrentDBDocument #Finally, setting up handles to the active Revit document
uiapp = DocumentManager.Instance.CurrentUIApplication #Setting a handle to the active Revit UI document
app = uiapp.Application  #Setting a handle to the currently-open instance of the Revit application
uidoc = uiapp.ActiveUIDocument #Setting a handle to the currently-open instance of the Revit UI application

#######OK NOW YOU CAN CODE########
category = UnwrapElement(IN[0])

walls = FilteredElementCollector(doc).OfCategoryId(category.Id).WhereElementIsNotElementType().ToElements()

names = []

for i in walls:
	name = i.Name
	names.append(name)
	

OUT = walls, names
# ----------------------------------------
all_elements_of_category = ElementsOfCategory(Category=categories)
name = Element.Name(element=all_elements_of_category)
filter_elements_by_category = Python()  # IronPython2; frozen; unwired: IN[0]
# ---------- filter_elements_by_category.python (62 lines) ----------
import clr #This is .NET's Common Language Runtime. It's an execution environment
#that is able to execute code from several different languages.
import sys #sys is a fundamental Python library - here, we're using it to load in
#the standard IronPython libraries
sys.path.append('C:\Program Files (x86)\IronPython 2.7\Lib') #Imports the
#standard IronPython libraries, which cover everything from servers and
#encryption through to regular expressions.
import System #The System namespace at the root of .NET
from System import Array #.NET class for handling array information
from System.Collections.Generic import * #Lets you handle generics. Revit's API
#sometimes wants hard-typed 'generic' lists, called ILists. If you don't need
#these you can delete this line.
clr.AddReference('ProtoGeometry')  #A Dynamo library for its proxy geometry
#classes. You'll only need this if you're interacting with geometry.
from Autodesk.DesignScript.Geometry import * #Loads everything in Dynamo's
#geometry library
clr.AddReference("RevitNodes") #Dynamo's nodes for Revit
import Revit #Loads in the Revit namespace in RevitNodes
clr.ImportExtensions(Revit.Elements) #More loading of Dynamo's Revit libraries
clr.ImportExtensions(Revit.GeometryConversion) #More loading of Dynamo's
#Revit libraries. You'll only need this if you're interacting with geometry.
clr.AddReference("RevitServices") #Dynamo's classes for handling Revit documents
import RevitServices 
from RevitServices.Persistence import DocumentManager #An internal Dynamo class
#that keeps track of the document that Dynamo is currently attached to
from RevitServices.Transactions import TransactionManager #A Dynamo class for
#opening and closing transactions to change the Revit document's database

clr.AddReference("RevitAPI") #Adding reference to Revit's API DLLs
clr.AddReference("RevitAPIUI") #Adding reference to Revit's API DLLs

import Autodesk #Loads the Autodesk namespace
from Autodesk.Revit.DB import * #Loading Revit's API classes
from Autodesk.Revit.UI import * #Loading Revit's API UI classes  

doc = DocumentManager.Instance.CurrentDBDocument #Finally, setting up handles to the active Revit document
uiapp = DocumentManager.Instance.CurrentUIApplication #Setting a handle to the active Revit UI document
app = uiapp.Application  #Setting a handle to the currently-open instance of the Revit application
uidoc = uiapp.ActiveUIDocument #Setting a handle to the currently-open instance of the Revit UI application

#######OK NOW YOU CAN CODE########
#category = UnwrapElement(IN[0])

category_name = BuiltInCategory.OST_Doors   #sempre trocar o nome de acordo

collector = FilteredElementCollector(doc).OfCategory(category_name)

#Items = collector.WhereElementIsNotElementType().ToElements()

#cuidado ao colocar varios filtros no mesmo coletor, ele irá fazer um AND, AND, AND.

Types = collector.WhereElementIsElementType().ToElements()

"""
names = []

for i in walls:
	name = i.Name
	names.append(name)
"""

OUT = Types
# ----------------------------------------
filter_elements_by_category_true = Python()  # IronPython2; frozen; unwired: IN[0]
# ---------- filter_elements_by_category_true.python (59 lines) ----------
import clr #This is .NET's Common Language Runtime. It's an execution environment
#that is able to execute code from several different languages.
import sys #sys is a fundamental Python library - here, we're using it to load in
#the standard IronPython libraries
sys.path.append('C:\Program Files (x86)\IronPython 2.7\Lib') #Imports the
#standard IronPython libraries, which cover everything from servers and
#encryption through to regular expressions.
import System #The System namespace at the root of .NET
from System import Array #.NET class for handling array information
from System.Collections.Generic import * #Lets you handle generics. Revit's API
#sometimes wants hard-typed 'generic' lists, called ILists. If you don't need
#these you can delete this line.
clr.AddReference('ProtoGeometry')  #A Dynamo library for its proxy geometry
#classes. You'll only need this if you're interacting with geometry.
from Autodesk.DesignScript.Geometry import * #Loads everything in Dynamo's
#geometry library
clr.AddReference("RevitNodes") #Dynamo's nodes for Revit
import Revit #Loads in the Revit namespace in RevitNodes
clr.ImportExtensions(Revit.Elements) #More loading of Dynamo's Revit libraries
clr.ImportExtensions(Revit.GeometryConversion) #More loading of Dynamo's
#Revit libraries. You'll only need this if you're interacting with geometry.
clr.AddReference("RevitServices") #Dynamo's classes for handling Revit documents
import RevitServices 
from RevitServices.Persistence import DocumentManager #An internal Dynamo class
#that keeps track of the document that Dynamo is currently attached to
from RevitServices.Transactions import TransactionManager #A Dynamo class for
#opening and closing transactions to change the Revit document's database

clr.AddReference("RevitAPI") #Adding reference to Revit's API DLLs
clr.AddReference("RevitAPIUI") #Adding reference to Revit's API DLLs

import Autodesk #Loads the Autodesk namespace
from Autodesk.Revit.DB import * #Loading Revit's API classes
from Autodesk.Revit.UI import * #Loading Revit's API UI classes  

doc = DocumentManager.Instance.CurrentDBDocument #Finally, setting up handles to the active Revit document
uiapp = DocumentManager.Instance.CurrentUIApplication #Setting a handle to the active Revit UI document
app = uiapp.Application  #Setting a handle to the currently-open instance of the Revit application
uidoc = uiapp.ActiveUIDocument #Setting a handle to the currently-open instance of the Revit UI application

#######OK NOW YOU CAN CODE########
#category = UnwrapElement(IN[0])

category_name = BuiltInCategory.OST_Doors   #sempre trocar o nome de acordo


InvertFilter = ElementCategoryFilter(category_name, True)

collector = FilteredElementCollector(doc).WherePasses(InvertFilter).ToElements()

"""
names = []

for i in walls:
	name = i.Name
	names.append(name)
"""

OUT = collector
# ----------------------------------------
filter_elements_by_category_2 = Python()  # "Filter Elements by Category() (False)"; IronPython2; frozen; unwired: IN[0]
# ---------- filter_elements_by_category_2.python (59 lines) ----------
import clr #This is .NET's Common Language Runtime. It's an execution environment
#that is able to execute code from several different languages.
import sys #sys is a fundamental Python library - here, we're using it to load in
#the standard IronPython libraries
sys.path.append('C:\Program Files (x86)\IronPython 2.7\Lib') #Imports the
#standard IronPython libraries, which cover everything from servers and
#encryption through to regular expressions.
import System #The System namespace at the root of .NET
from System import Array #.NET class for handling array information
from System.Collections.Generic import * #Lets you handle generics. Revit's API
#sometimes wants hard-typed 'generic' lists, called ILists. If you don't need
#these you can delete this line.
clr.AddReference('ProtoGeometry')  #A Dynamo library for its proxy geometry
#classes. You'll only need this if you're interacting with geometry.
from Autodesk.DesignScript.Geometry import * #Loads everything in Dynamo's
#geometry library
clr.AddReference("RevitNodes") #Dynamo's nodes for Revit
import Revit #Loads in the Revit namespace in RevitNodes
clr.ImportExtensions(Revit.Elements) #More loading of Dynamo's Revit libraries
clr.ImportExtensions(Revit.GeometryConversion) #More loading of Dynamo's
#Revit libraries. You'll only need this if you're interacting with geometry.
clr.AddReference("RevitServices") #Dynamo's classes for handling Revit documents
import RevitServices 
from RevitServices.Persistence import DocumentManager #An internal Dynamo class
#that keeps track of the document that Dynamo is currently attached to
from RevitServices.Transactions import TransactionManager #A Dynamo class for
#opening and closing transactions to change the Revit document's database

clr.AddReference("RevitAPI") #Adding reference to Revit's API DLLs
clr.AddReference("RevitAPIUI") #Adding reference to Revit's API DLLs

import Autodesk #Loads the Autodesk namespace
from Autodesk.Revit.DB import * #Loading Revit's API classes
from Autodesk.Revit.UI import * #Loading Revit's API UI classes  

doc = DocumentManager.Instance.CurrentDBDocument #Finally, setting up handles to the active Revit document
uiapp = DocumentManager.Instance.CurrentUIApplication #Setting a handle to the active Revit UI document
app = uiapp.Application  #Setting a handle to the currently-open instance of the Revit application
uidoc = uiapp.ActiveUIDocument #Setting a handle to the currently-open instance of the Revit UI application

#######OK NOW YOU CAN CODE########
#category = UnwrapElement(IN[0])

category_name = BuiltInCategory.OST_Doors   #sempre trocar o nome de acordo


InvertFilter = ElementCategoryFilter(category_name, False)

collector = FilteredElementCollector(doc).WherePasses(InvertFilter).ToElements()

"""
names = []

for i in walls:
	name = i.Name
	names.append(name)
"""

OUT = collector
# ----------------------------------------
icollection_filtering_by = Python()  # "ICollection - Filtering by multiple categories"; IronPython2; frozen; unwired: IN[0]
# ---------- icollection_filtering_by.python (55 lines) ----------
import clr #This is .NET's Common Language Runtime. It's an execution environment
#that is able to execute code from several different languages.
import sys #sys is a fundamental Python library - here, we're using it to load in
#the standard IronPython libraries
sys.path.append('C:\Program Files (x86)\IronPython 2.7\Lib') #Imports the
#standard IronPython libraries, which cover everything from servers and
#encryption through to regular expressions.
import System #The System namespace at the root of .NET
from System import Array #.NET class for handling array information
from System.Collections.Generic import * #Lets you handle generics. Revit's API
#sometimes wants hard-typed 'generic' lists, called ILists. If you don't need
#these you can delete this line.
clr.AddReference('ProtoGeometry')  #A Dynamo library for its proxy geometry
#classes. You'll only need this if you're interacting with geometry.
from Autodesk.DesignScript.Geometry import * #Loads everything in Dynamo's
#geometry library
clr.AddReference("RevitNodes") #Dynamo's nodes for Revit
import Revit #Loads in the Revit namespace in RevitNodes
clr.ImportExtensions(Revit.Elements) #More loading of Dynamo's Revit libraries
clr.ImportExtensions(Revit.GeometryConversion) #More loading of Dynamo's
#Revit libraries. You'll only need this if you're interacting with geometry.
clr.AddReference("RevitServices") #Dynamo's classes for handling Revit documents
import RevitServices 
from RevitServices.Persistence import DocumentManager #An internal Dynamo class
#that keeps track of the document that Dynamo is currently attached to
from RevitServices.Transactions import TransactionManager #A Dynamo class for
#opening and closing transactions to change the Revit document's database

clr.AddReference("RevitAPI") #Adding reference to Revit's API DLLs
clr.AddReference("RevitAPIUI") #Adding reference to Revit's API DLLs

import Autodesk #Loads the Autodesk namespace
from Autodesk.Revit.DB import * #Loading Revit's API classes
from Autodesk.Revit.UI import * #Loading Revit's API UI classes  

doc = DocumentManager.Instance.CurrentDBDocument #Finally, setting up handles to the active Revit document
uiapp = DocumentManager.Instance.CurrentUIApplication #Setting a handle to the active Revit UI document
app = uiapp.Application  #Setting a handle to the currently-open instance of the Revit application
uidoc = uiapp.ActiveUIDocument #Setting a handle to the currently-open instance of the Revit UI application

#######OK NOW YOU CAN CODE########

categories = List[BuiltInCategory]()

floors = BuiltInCategory.OST_Floors
ceilings = BuiltInCategory.OST_Ceilings

categories.Add(floors)
categories.Add(ceilings)

Filter = ElementMulticategoryFilter(categories)

Elements_= FilteredElementCollector(doc).WherePasses(Filter).ToElements()

OUT = Elements_
# ----------------------------------------
filter_by_class = Python()  # IronPython2; unwired: IN[0]
# ---------- filter_by_class.python (47 lines) ----------
import clr #This is .NET's Common Language Runtime. It's an execution environment
#that is able to execute code from several different languages.
import sys #sys is a fundamental Python library - here, we're using it to load in
#the standard IronPython libraries
sys.path.append('C:\Program Files (x86)\IronPython 2.7\Lib') #Imports the
#standard IronPython libraries, which cover everything from servers and
#encryption through to regular expressions.
import System #The System namespace at the root of .NET
from System import Array #.NET class for handling array information
from System.Collections.Generic import * #Lets you handle generics. Revit's API
#sometimes wants hard-typed 'generic' lists, called ILists. If you don't need
#these you can delete this line.
clr.AddReference('ProtoGeometry')  #A Dynamo library for its proxy geometry
#classes. You'll only need this if you're interacting with geometry.
from Autodesk.DesignScript.Geometry import * #Loads everything in Dynamo's
#geometry library
clr.AddReference("RevitNodes") #Dynamo's nodes for Revit
import Revit #Loads in the Revit namespace in RevitNodes
clr.ImportExtensions(Revit.Elements) #More loading of Dynamo's Revit libraries
clr.ImportExtensions(Revit.GeometryConversion) #More loading of Dynamo's
#Revit libraries. You'll only need this if you're interacting with geometry.
clr.AddReference("RevitServices") #Dynamo's classes for handling Revit documents
import RevitServices 
from RevitServices.Persistence import DocumentManager #An internal Dynamo class
#that keeps track of the document that Dynamo is currently attached to
from RevitServices.Transactions import TransactionManager #A Dynamo class for
#opening and closing transactions to change the Revit document's database

clr.AddReference("RevitAPI") #Adding reference to Revit's API DLLs
clr.AddReference("RevitAPIUI") #Adding reference to Revit's API DLLs

import Autodesk #Loads the Autodesk namespace
from Autodesk.Revit.DB import * #Loading Revit's API classes
from Autodesk.Revit.UI import * #Loading Revit's API UI classes  

doc = DocumentManager.Instance.CurrentDBDocument #Finally, setting up handles to the active Revit document
uiapp = DocumentManager.Instance.CurrentUIApplication #Setting a handle to the active Revit UI document
app = uiapp.Application  #Setting a handle to the currently-open instance of the Revit application
uidoc = uiapp.ActiveUIDocument #Setting a handle to the currently-open instance of the Revit UI application

#######OK NOW YOU CAN CODE########

Filter_ = ElementClassFilter(Level)

allLevel = FilteredElementCollector(doc).WherePasses(Filter_).ToElements()

OUT = allLevel
# ----------------------------------------
all_classes_filter = Python()  # IronPython2; unwired: IN[0]
# ---------- all_classes_filter.python (363 lines) ----------
import clr #This is .NET's Common Language Runtime. It's an execution environment
#that is able to execute code from several different languages.
import sys #sys is a fundamental Python library - here, we're using it to load in
#the standard IronPython libraries
sys.path.append('C:\Program Files (x86)\IronPython 2.7\Lib') #Imports the
#standard IronPython libraries, which cover everything from servers and
#encryption through to regular expressions.
import System #The System namespace at the root of .NET
from System import Array #.NET class for handling array information
from System.Collections.Generic import * #Lets you handle generics. Revit's API
#sometimes wants hard-typed 'generic' lists, called ILists. If you don't need
#these you can delete this line.
clr.AddReference('ProtoGeometry')  #A Dynamo library for its proxy geometry
#classes. You'll only need this if you're interacting with geometry.
from Autodesk.DesignScript.Geometry import * #Loads everything in Dynamo's
#geometry library
clr.AddReference("RevitNodes") #Dynamo's nodes for Revit
import Revit #Loads in the Revit namespace in RevitNodes
clr.ImportExtensions(Revit.Elements) #More loading of Dynamo's Revit libraries
clr.ImportExtensions(Revit.GeometryConversion) #More loading of Dynamo's
#Revit libraries. You'll only need this if you're interacting with geometry.
clr.AddReference("RevitServices") #Dynamo's classes for handling Revit documents
import RevitServices 
from RevitServices.Persistence import DocumentManager #An internal Dynamo class
#that keeps track of the document that Dynamo is currently attached to
from RevitServices.Transactions import TransactionManager #A Dynamo class for
#opening and closing transactions to change the Revit document's database

clr.AddReference("RevitAPI") #Adding reference to Revit's API DLLs
clr.AddReference("RevitAPIUI") #Adding reference to Revit's API DLLs

import Autodesk #Loads the Autodesk namespace
from Autodesk.Revit.DB import * #Loading Revit's API classes
from Autodesk.Revit.UI import * #Loading Revit's API UI classes  

doc = DocumentManager.Instance.CurrentDBDocument #Finally, setting up handles to the active Revit document
uiapp = DocumentManager.Instance.CurrentUIApplication #Setting a handle to the active Revit UI document
app = uiapp.Application  #Setting a handle to the currently-open instance of the Revit application
uidoc = uiapp.ActiveUIDocument #Setting a handle to the currently-open instance of the Revit UI application

#######OK NOW YOU CAN CODE########
"""
# AssemblyInstance
Filter_ = ElementClassFilter(AssemblyInstance)
allAssemblyInstance = FilteredElementCollector(doc).WherePasses(Filter_).ToElements()
OUT = allAssemblyInstance

# GridType
Filter_ = ElementClassFilter(GridType)
allGridType = FilteredElementCollector(doc).WherePasses(Filter_).ToElements()
OUT = allGridType

# ParameterElement
Filter_ = ElementClassFilter(ParameterElement)
allParameterElement = FilteredElementCollector(doc).WherePasses(Filter_).ToElements()
OUT = allParameterElement

# TilePattern
Filter_ = ElementClassFilter(TilePattern)
allTilePattern = FilteredElementCollector(doc).WherePasses(Filter_).ToElements()
OUT = allTilePattern

# AssemblyType
Filter_ = ElementClassFilter(AssemblyType)
allAssemblyType = FilteredElementCollector(doc).WherePasses(Filter_).ToElements()
OUT = allAssemblyType

# Group
Filter_ = ElementClassFilter(Group)
allGroup = FilteredElementCollector(doc).WherePasses(Filter_).ToElements()
OUT = allGroup

# Phase
Filter_ = ElementClassFilter(Phase)
allPhase = FilteredElementCollector(doc).WherePasses(Filter_).ToElements()
OUT = allPhase

# View3D
Filter_ = ElementClassFilter(View3D)
allView3D = FilteredElementCollector(doc).WherePasses(Filter_).ToElements()
OUT = allView3D

# BeamSystem
Filter_ = ElementClassFilter(BeamSystem)
allBeamSystem = FilteredElementCollector(doc).WherePasses(Filter_).ToElements()
OUT = allBeamSystem

# ImageType
Filter_ = ElementClassFilter(ImageType)
allImageType = FilteredElementCollector(doc).WherePasses(Filter_).ToElements()
OUT = allImageType

# ProjectInfo
Filter_ = ElementClassFilter(ProjectInfo)
allProjectInfo = FilteredElementCollector(doc).WherePasses(Filter_).ToElements()
OUT = allProjectInfo

# ViewPlan
Filter_ = ElementClassFilter(ViewPlan)
allViewPlan = FilteredElementCollector(doc).WherePasses(Filter_).ToElements()
OUT = allViewPlan

# BeamSystemType
Filter_ = ElementClassFilter(BeamSystemType)
allBeamSystemType = FilteredElementCollector(doc).WherePasses(Filter_).ToElements()
OUT = allBeamSystemType

# ImageView
Filter_ = ElementClassFilter(ImageView)
allImageView = FilteredElementCollector(doc).WherePasses(Filter_).ToElements()
OUT = allImageView

# ProjectLocation
Filter_ = ElementClassFilter(ProjectLocation)
allProjectLocation = FilteredElementCollector(doc).WherePasses(Filter_).ToElements()
OUT = allProjectLocation

# ViewPlanType
Filter_ = ElementClassFilter(ViewPlanType)
allViewPlanType = FilteredElementCollector(doc).WherePasses(Filter_).ToElements()
OUT = allViewPlanType

# CADLinkType
Filter_ = ElementClassFilter(CADLinkType)
allCADLinkType = FilteredElementCollector(doc).WherePasses(Filter_).ToElements()
OUT = allCADLinkType

# IndependentTag
Filter_ = ElementClassFilter(IndependentTag)
allIndependentTag = FilteredElementCollector(doc).WherePasses(Filter_).ToElements()
OUT = allIndependentTag

# PropertyLine
Filter_ = ElementClassFilter(PropertyLine)
allPropertyLine = FilteredElementCollector(doc).WherePasses(Filter_).ToElements()
OUT = allPropertyLine

# ViewSchedule
Filter_ = ElementClassFilter(ViewSchedule)
allViewSchedule = FilteredElementCollector(doc).WherePasses(Filter_).ToElements()
OUT = allViewSchedule

# Ceiling
Filter_ = ElementClassFilter(Ceiling)
allCeiling = FilteredElementCollector(doc).WherePasses(Filter_).ToElements()
OUT = allCeiling

# InsertableObject
Filter_ = ElementClassFilter(InsertableObject)
allInsertableObject = FilteredElementCollector(doc).WherePasses(Filter_).ToElements()
OUT = allInsertableObject

# Revision
Filter_ = ElementClassFilter(Revision)
allRevision = FilteredElementCollector(doc).WherePasses(Filter_).ToElements()
OUT = allRevision

# ViewSection
Filter_ = ElementClassFilter(ViewSection)
allViewSection = FilteredElementCollector(doc).WherePasses(Filter_).ToElements()
OUT = allViewSection

# CeilingAndFloor
Filter_ = ElementClassFilter(CeilingAndFloor)
allCeilingAndFloor = FilteredElementCollector(doc).WherePasses(Filter_).ToElements()
OUT = allCeilingAndFloor

# Level
Filter_ = ElementClassFilter(Level)
allLevel = FilteredElementCollector(doc).WherePasses(Filter_).ToElements()
OUT = allLevel

# RevisionCloud
Filter_ = ElementClassFilter(RevisionCloud)
allRevisionCloud = FilteredElementCollector(doc).WherePasses(Filter_).ToElements()
OUT = allRevisionCloud

# ViewSheet
Filter_ = ElementClassFilter(ViewSheet)
allViewSheet = FilteredElementCollector(doc).WherePasses(Filter_).ToElements()
OUT = allViewSheet

# CeilingType
Filter_ = ElementClassFilter(CeilingType)
allCeilingType = FilteredElementCollector(doc).WherePasses(Filter_).ToElements()
OUT = allCeilingType

# MEPCurve
Filter_ = ElementClassFilter(MEPCurve)
allMEPCurve = FilteredElementCollector(doc).WherePasses(Filter_).ToElements()
OUT = allMEPCurve

# RevitLinkInstance
Filter_ = ElementClassFilter(RevitLinkInstance)
allRevitLinkInstance = FilteredElementCollector(doc).WherePasses(Filter_).ToElements()
OUT = allRevitLinkInstance

# Viewport
Filter_ = ElementClassFilter(Viewport)
allViewport = FilteredElementCollector(doc).WherePasses(Filter_).ToElements()
OUT = allViewport

# CurtainSystem
Filter_ = ElementClassFilter(CurtainSystem)
allCurtainSystem = FilteredElementCollector(doc).WherePasses(Filter_).ToElements()
OUT = allCurtainSystem

# MEPSystem
Filter_ = ElementClassFilter(MEPSystem)
allMEPSystem = FilteredElementCollector(doc).WherePasses(Filter_).ToElements()
OUT = allMEPSystem

# RevitLinkType
Filter_ = ElementClassFilter(RevitLinkType)
allRevitLinkType = FilteredElementCollector(doc).WherePasses(Filter_).ToElements()
OUT = allRevitLinkType

# Wall
Filter_ = ElementClassFilter(Wall)
allWall = FilteredElementCollector(doc).WherePasses(Filter_).ToElements()
OUT = allWall

# Dimension
Filter_ = ElementClassFilter(Dimension)
allDimension = FilteredElementCollector(doc).WherePasses(Filter_).ToElements()
OUT = allDimension

# Material
Filter_ = ElementClassFilter(Material)
allMaterial = FilteredElementCollector(doc).WherePasses(Filter_).ToElements()
OUT = allMaterial

# RoofType
Filter_ = ElementClassFilter(RoofType)
allRoofType = FilteredElementCollector(doc).WherePasses(Filter_).ToElements()
OUT = allRoofType

# WallFoundation
Filter_ = ElementClassFilter(WallFoundation)
allWallFoundation = FilteredElementCollector(doc).WherePasses(Filter_).ToElements()
OUT = allWallFoundation

# DirectShape
Filter_ = ElementClassFilter(DirectShape)
allDirectShape = FilteredElementCollector(doc).WherePasses(Filter_).ToElements()
OUT = allDirectShape

# SharedParameterElement
Filter_ = ElementClassFilter(SharedParameterElement)
allSharedParameterElement = FilteredElementCollector(doc).WherePasses(Filter_).ToElements()
OUT = allSharedParameterElement

# WallFoundationType
Filter_ = ElementClassFilter(WallFoundationType)
allWallFoundationType = FilteredElementCollector(doc).WherePasses(Filter_).ToElements()
OUT = allWallFoundationType

# SlabEdge
Filter_ = ElementClassFilter(SlabEdge)
allSlabEdge = FilteredElementCollector(doc).WherePasses(Filter_).ToElements()
OUT = allSlabEdge

# WallSweep
Filter_ = ElementClassFilter(WallSweep)
allWallSweep = FilteredElementCollector(doc).WherePasses(Filter_).ToElements()
OUT = allWallSweep

# Family
Filter_ = ElementClassFilter(Family)
allFamily = FilteredElementCollector(doc).WherePasses(Filter_).ToElements()
OUT = allFamily

# SpatialElement
Filter_ = ElementClassFilter(SpatialElement)
allSpatialElement = FilteredElementCollector(doc).WherePasses(Filter_).ToElements()
OUT = allSpatialElement

# WallSweepType
Filter_ = ElementClassFilter(WallSweepType)
allWallSweepType = FilteredElementCollector(doc).WherePasses(Filter_).ToElements()
OUT = allWallSweepType

# FamilyInstance
Filter_ = ElementClassFilter(FamilyInstance)
allFamilyInstance = FilteredElementCollector(doc).WherePasses(Filter_).ToElements()
OUT = allFamilyInstance

# ModelText
Filter_ = ElementClassFilter(ModelText)
allModelText = FilteredElementCollector(doc).WherePasses(Filter_).ToElements()
OUT = allModelText

# Sweep
Filter_ = ElementClassFilter(Sweep)
allSweep = FilteredElementCollector(doc).WherePasses(Filter_).ToElements()
OUT = allSweep

# WallType
Filter_ = ElementClassFilter(WallType)
allWallType = FilteredElementCollector(doc).WherePasses(Filter_).ToElements()
OUT = allWallType

# FamilySymbol
Filter_ = ElementClassFilter(FamilySymbol)
allFamilySymbol = FilteredElementCollector(doc).WherePasses(Filter_).ToElements()
OUT = allFamilySymbol

# ModelTextType
Filter_ = ElementClassFilter(ModelTextType)
allModelTextType = FilteredElementCollector(doc).WherePasses(Filter_).ToElements()
OUT = allModelTextType

# FilledRegion
Filter_ = ElementClassFilter(FilledRegion)
allFilledRegion = FilteredElementCollector(doc).WherePasses(Filter_).ToElements()
OUT = allFilledRegion

# MullionType
Filter_ = ElementClassFilter(MullionType)
allMullionType = FilteredElementCollector(doc).WherePasses(Filter_).ToElements()
OUT = allMullionType

# TableView
Filter_ = ElementClassFilter(TableView)
allTableView = FilteredElementCollector(doc).WherePasses(Filter_).ToElements()
OUT = allTableView

# Floor
Filter_ = ElementClassFilter(Floor)
allFloor = FilteredElementCollector(doc).WherePasses(Filter_).ToElements()
OUT = allFloor

# NestedFamilyTypeReference
Filter_ = ElementClassFilter(NestedFamilyTypeReference)
allNestedFamilyTypeReference = FilteredElementCollector(doc).WherePasses(Filter_).ToElements()
OUT = allNestedFamilyTypeReference

# TextElement
Filter_ = ElementClassFilter(TextElement)
allTextElement = FilteredElementCollector(doc).WherePasses(Filter_).ToElements()
OUT = allTextElement

# FloorType
Filter_ = ElementClassFilter(FloorType)
allFloorType = FilteredElementCollector(doc).WherePasses(Filter_).ToElements()
OUT = allFloorType

# Grid
Filter_ = ElementClassFilter(Grid)
allGrid = FilteredElementCollector(doc).WherePasses(Filter_).ToElements()
OUT = allGrid

# PanelType
Filter_ = ElementClassFilter(PanelType)
allPanelType = FilteredElementCollector(doc).WherePasses(Filter_).ToElements()
OUT = allPanelType

# TextElementType
Filter_ = ElementClassFilter(TextElementType)
allTextElementType = FilteredElementCollector(doc).WherePasses(Filter_).ToElements()
OUT = allTextElementType

"""
# ----------------------------------------
elements_visible_in_view = Python()  # IronPython2; unwired: IN[0]
# ---------- elements_visible_in_view.python (47 lines) ----------
import clr #This is .NET's Common Language Runtime. It's an execution environment
#that is able to execute code from several different languages.
import sys #sys is a fundamental Python library - here, we're using it to load in
#the standard IronPython libraries
sys.path.append('C:\Program Files (x86)\IronPython 2.7\Lib') #Imports the
#standard IronPython libraries, which cover everything from servers and
#encryption through to regular expressions.
import System #The System namespace at the root of .NET
from System import Array #.NET class for handling array information
from System.Collections.Generic import * #Lets you handle generics. Revit's API
#sometimes wants hard-typed 'generic' lists, called ILists. If you don't need
#these you can delete this line.
clr.AddReference('ProtoGeometry')  #A Dynamo library for its proxy geometry
#classes. You'll only need this if you're interacting with geometry.
from Autodesk.DesignScript.Geometry import * #Loads everything in Dynamo's
#geometry library
clr.AddReference("RevitNodes") #Dynamo's nodes for Revit
import Revit #Loads in the Revit namespace in RevitNodes
clr.ImportExtensions(Revit.Elements) #More loading of Dynamo's Revit libraries
clr.ImportExtensions(Revit.GeometryConversion) #More loading of Dynamo's
#Revit libraries. You'll only need this if you're interacting with geometry.
clr.AddReference("RevitServices") #Dynamo's classes for handling Revit documents
import RevitServices 
from RevitServices.Persistence import DocumentManager #An internal Dynamo class
#that keeps track of the document that Dynamo is currently attached to
from RevitServices.Transactions import TransactionManager #A Dynamo class for
#opening and closing transactions to change the Revit document's database

clr.AddReference("RevitAPI") #Adding reference to Revit's API DLLs
clr.AddReference("RevitAPIUI") #Adding reference to Revit's API DLLs

import Autodesk #Loads the Autodesk namespace
from Autodesk.Revit.DB import * #Loading Revit's API classes
from Autodesk.Revit.UI import * #Loading Revit's API UI classes  

doc = DocumentManager.Instance.CurrentDBDocument #Finally, setting up handles to the active Revit document
uiapp = DocumentManager.Instance.CurrentUIApplication #Setting a handle to the active Revit UI document
app = uiapp.Application  #Setting a handle to the currently-open instance of the Revit application
uidoc = uiapp.ActiveUIDocument #Setting a handle to the currently-open instance of the Revit UI application

#######OK NOW YOU CAN CODE########

view = doc.ActiveView.Id

elem_inview = FilteredElementCollector(doc, view).OfCategory(BuiltInCategory.OST_Entourage)

OUT = elem_inview
# ----------------------------------------
select_model_element = DSModelElementSelection()  # 1 picked in the model
elements_intersecting_a_bounding = Python(IN[0]=select_model_element)  # "Elements Intersecting a Bounding Box"; IronPython2
# ---------- elements_intersecting_a_bounding.python (54 lines) ----------
import clr #This is .NET's Common Language Runtime. It's an execution environment
#that is able to execute code from several different languages.
import sys #sys is a fundamental Python library - here, we're using it to load in
#the standard IronPython libraries
sys.path.append('C:\Program Files (x86)\IronPython 2.7\Lib') #Imports the
#standard IronPython libraries, which cover everything from servers and
#encryption through to regular expressions.
import System #The System namespace at the root of .NET
from System import Array #.NET class for handling array information
from System.Collections.Generic import * #Lets you handle generics. Revit's API
#sometimes wants hard-typed 'generic' lists, called ILists. If you don't need
#these you can delete this line.
clr.AddReference('ProtoGeometry')  #A Dynamo library for its proxy geometry
#classes. You'll only need this if you're interacting with geometry.
from Autodesk.DesignScript.Geometry import * #Loads everything in Dynamo's
#geometry library
clr.AddReference("RevitNodes") #Dynamo's nodes for Revit
import Revit #Loads in the Revit namespace in RevitNodes
clr.ImportExtensions(Revit.Elements) #More loading of Dynamo's Revit libraries
clr.ImportExtensions(Revit.GeometryConversion) #More loading of Dynamo's
#Revit libraries. You'll only need this if you're interacting with geometry.
clr.AddReference("RevitServices") #Dynamo's classes for handling Revit documents
import RevitServices 
from RevitServices.Persistence import DocumentManager #An internal Dynamo class
#that keeps track of the document that Dynamo is currently attached to
from RevitServices.Transactions import TransactionManager #A Dynamo class for
#opening and closing transactions to change the Revit document's database

clr.AddReference("RevitAPI") #Adding reference to Revit's API DLLs
clr.AddReference("RevitAPIUI") #Adding reference to Revit's API DLLs

import Autodesk #Loads the Autodesk namespace
from Autodesk.Revit.DB import * #Loading Revit's API classes
from Autodesk.Revit.UI import * #Loading Revit's API UI classes  

doc = DocumentManager.Instance.CurrentDBDocument #Finally, setting up handles to the active Revit document
uiapp = DocumentManager.Instance.CurrentUIApplication #Setting a handle to the active Revit UI document
app = uiapp.Application  #Setting a handle to the currently-open instance of the Revit application
uidoc = uiapp.ActiveUIDocument #Setting a handle to the currently-open instance of the Revit UI application

#######OK NOW YOU CAN CODE########

elements = UnwrapElement(IN[0])
bb = elements.get_BoundingBox(doc.ActiveView)

outline = Outline(bb.Min, bb.Max)

tolerance = -0.01

Filter = BoundingBoxIntersectsFilter(outline, tolerance, False)

elems = FilteredElementCollector(doc, doc.ActiveView.Id).WherePasses(Filter)

OUT = elems
# ----------------------------------------
