# Dynamo graph PYTHON TEMPLATE.dyn "PYTHON SYNTAX" (Dynamo 2.12.1.8246)

# note: Variable Names
# A variable can have a short name (x and y) or a more descriptive name (age, carName, total_volume).
# Rules for Python variables:
# 1 - A variable name must begin with a letter or an underscore character.
# 2 - A variable name cannot begin with a number.
# 3 - A variable name can only contain alphanumeric characters and underscores.
# 4 - A variable name cannot contain mathematical symbols such as +, -, *, /
# 5 - A variable name cannot contain special symbols suc as !, @, #, $, %;
# 6 - A variable name cannot contain spaces.
# 7 - A variable name cannot be a reserved word.
# CASE SENSITIVE = age, AGE, and Age this is different variables.
# Reserved Word:
# and
# as
# assert
# break
# class
# continue
# def
# del
# elif
# else
# except
# exec
# finally
# for
# from
# global
# if
# import
# in
# is
# Lambda
# not
# or
# pass
# print
# raise
# return
# try
# while
# with
# yield.

# group: NUMBERS
# note: Legal variable names
# myvar = 0
# my_var = 0
# _my_var = 0
# myVAR = 0
# myvar2 = 0
# Ilegal variable names
# 2myvar = 0
# my-var = 0
# my var = 0
# elif = 0
# note: Camel Case
# In the case of creating variable names through phrases or compound words, the Camel Case writing style can be used.
# UpperCamelCase (PascalCase) = ConduitLengthValue
# lowerCamelCase = conduitLengthValue
A = DoubleInput(3.44)
# note: Note 1 - When bringing Revit elements into a Python node, use "unwrapped".
B = DoubleInput(4)
NUMBERS = Python(IN[0]=A, IN[1]=B)  # IronPython2
# ---------- NUMBERS.python (19 lines) ----------
# Load the Python Standard and DesignScript Libraries
import sys
import clr
clr.AddReference('ProtoGeometry')
from Autodesk.DesignScript.Geometry import *

# The inputs to this node will be stored as a list in the IN variables.
x = IN[0]
y = IN[1]

# x = 1 ( int) 
# x = 1.2 (float)
# x = 5j (complex)


# Place your code below this line

# Assign your output to the OUT variable.
OUT = float(x)
# ----------------------------------------

# group: STRING METHODS
capitalize = StringInput("""txt = IN[0].capitalize()
OUT = txt""")
A_2 = StringInput("BUONGIORNO")  # frozen
python_script_from_string = PythonStringNode(script=capitalize, IN[0]=A_2)  # IronPython2
center = StringInput("""txt = IN[0].center(20)
OUT = txt""")
python_script_from_string_2 = PythonStringNode(script=center, IN[0]=A_2)  # IronPython2
count = StringInput("""txt = IN[0].count("N")
OUT = txt""")
python_script_from_string_3 = PythonStringNode(script=count, IN[0]=A_2)  # IronPython2
count_range = StringInput("""txt = IN[0].count("N", 1,5)
OUT = txt""")
python_script_from_string_4 = PythonStringNode(script=count_range, IN[0]=A_2)  # IronPython2
endswith = StringInput("""txt = IN[0].endswith("O")
OUT = txt""")
python_script_from_string_5 = PythonStringNode(script=endswith, IN[0]=A_2)  # IronPython2
join = StringInput("""txt = IN[0]
OUT = (" ".join(txt))""")
python_script_from_string_6 = PythonStringNode(script=join, IN[0]=A_2)  # IronPython2
expandtabs = StringInput("""txt = IN[0]
OUT = txt.expandtabs(1)""")
python_script_from_string_7 = PythonStringNode(script=expandtabs, IN[0]=A_2)  # IronPython2
find = StringInput("""txt = IN[0].find("r")
OUT = txt""")
python_script_from_string_8 = PythonStringNode(script=find, IN[0]=A_2)  # IronPython2
index = StringInput("""txt = IN[0].index("O")
OUT = txt""")
python_script_from_string_9 = PythonStringNode(script=index, IN[0]=A_2)  # IronPython2
isalnum = StringInput("""txt = IN[0]
OUT = txt.isalnum()""")
code_block = CodeBlock { "23buongiorno"; }
python_script_from_string_10 = PythonStringNode(script=isalnum, IN[0]=code_block)  # IronPython2; frozen
isdecimal = StringInput("""txt = IN[0]
OUT = txt.isdecimal()""")
code_block_2 = CodeBlock { "23236567"; }
python_script_from_string_11 = PythonStringNode(script=isdecimal, IN[0]=code_block_2)  # IronPython2; frozen
isdigit = StringInput("""txt = IN[0]
OUT = txt.isdigit()""")
code_block_3 = CodeBlock { "236567"; }
python_script_from_string_12 = PythonStringNode(script=isdigit, IN[0]=code_block_3)  # IronPython2; frozen
islower_isupper = StringInput("""txt = IN[0]
OUT = txt.isupper()""")
code_block_4 = CodeBlock { "BUONGIORNO"; }
python_script_from_string_13 = PythonStringNode(script=islower_isupper, IN[0]=code_block_4)  # IronPython2; frozen
isspace = StringInput("""txt = IN[0]
OUT = txt.isspace()""")
code_block_5 = CodeBlock { "           "; }
python_script_from_string_14 = PythonStringNode(script=isspace, IN[0]=code_block_5)  # IronPython2; frozen
upper_and_lower = StringInput("""txt = IN[0]
OUT = txt.upper()""")
code_block_6 = CodeBlock { "Buongiorno"; }
python_script_from_string_15 = PythonStringNode(script=upper_and_lower, IN[0]=code_block_6)  # IronPython2; frozen
replace = StringInput("""txt = IN[0]
OUT = txt.replace("Buongiorno","buonanotte")""")
code_block_7 = CodeBlock { "Buongiorno"; }
python_script_from_string_16 = PythonStringNode(script=replace, IN[0]=code_block_7)  # IronPython2; frozen
split_and_rsplit = StringInput("""txt = IN[0].split(" ")
OUT = txt""")
code_block_8 = CodeBlock { "'Salve' è un saluto versatile che può essere usato in qualsiasi momento della giornata, ma spesso viene usato al mattino come sostituto di 'buongiorno'"; }
python_script_from_string_17 = PythonStringNode(script=split_and_rsplit, IN[0]=code_block_8)  # IronPython2; frozen

# group: FORMAT - PRINT
price = DoubleInput(2000)
format = Python(IN[0]=price)  # IronPython2; frozen
# ---------- format.python (13 lines) ----------
# Load the Python Standard and DesignScript Libraries
import sys
import clr
clr.AddReference('ProtoGeometry')
from Autodesk.DesignScript.Geometry import *

# The inputs to this node will be stored as a list in the IN variables.
price = IN[0]

# Place your code below this line
txt = "Price is {} euros"
# Assign your output to the OUT variable.
OUT = txt.format(price)
# ----------------------------------------
string = StringInput("567")
price_2 = DoubleInput(2000)
string_2 = StringInput("3")
format_2 = Python(IN[0]=string, IN[1]=price_2, IN[2]=string_2)  # IronPython2; frozen
# ---------- format_2.python (15 lines) ----------
# Load the Python Standard and DesignScript Libraries
import sys
import clr
clr.AddReference('ProtoGeometry')
from Autodesk.DesignScript.Geometry import *

# The inputs to this node will be stored as a list in the IN variables.
price = IN[0]
order = IN[1]
itemNo = IN[2]

# Place your code below this line
myorder = "I want {} items with numer {} for {} euros."
# Assign your output to the OUT variable.
OUT = myorder.format(order, itemNo, price)
# ----------------------------------------

# group: BOOLEAN
number = DoubleInput(9)
number_2 = DoubleInput(10)
boolean = Python(IN[0]=number, IN[1]=number_2)  # IronPython2; frozen
# ---------- boolean.python (17 lines) ----------
# Load the Python Standard and DesignScript Libraries
import sys
import clr
clr.AddReference('ProtoGeometry')
from Autodesk.DesignScript.Geometry import *

# The inputs to this node will be stored as a list in the IN variables.
x = IN[0]
y = IN[1]
# Place your code below this line

if x > y:
	txt1 = "{} is greater than {}"
	OUT = txt1.format(x,y)
else:
	txt2 = "{} is not greater than {}"
	OUT = txt2.format(x,y)
# ----------------------------------------
number_3 = DoubleInput(9)
number_4 = DoubleInput(10)
true_or_false = Python(IN[0]=number_3, IN[1]=number_4)  # IronPython2; frozen
# ---------- true_or_false.python (14 lines) ----------
# Load the Python Standard and DesignScript Libraries
import sys
import clr
clr.AddReference('ProtoGeometry')
from Autodesk.DesignScript.Geometry import *

# The inputs to this node will be stored as a list in the IN variables.
x = IN[0]
y = IN[1]
# Place your code below this line

True = bool(x < 10)

OUT = True
# ----------------------------------------

# group: TYPE
number_5 = DoubleInput(9)
isinstance = Python(IN[0]=number_5)  # IronPython2; frozen
# ---------- isinstance.python (12 lines) ----------
# Load the Python Standard and DesignScript Libraries
import sys
import clr
clr.AddReference('ProtoGeometry')
from Autodesk.DesignScript.Geometry import *

# The inputs to this node will be stored as a list in the IN variables.
x = IN[0]

# Place your code below this line

OUT = isinstance(x, float), isinstance(x, str), isinstance(x, int)
# ----------------------------------------
number_6 = DoubleInput(9)
element_type = Python(IN[0]=number_6)  # IronPython2; frozen
# ---------- element_type.python (17 lines) ----------
# Load the Python Standard and DesignScript Libraries
import sys
import clr
clr.AddReference('ProtoGeometry')
from Autodesk.DesignScript.Geometry import *

# The inputs to this node will be stored as a list in the IN variables.
x = IN[0]

tupla = tuple()

#its type can be queried using the following declarations
tipo = tupla.GetType(), clr.GetClrType(type(tupla)).ToString(),clr.GetPythonType(type(tupla)).__name__

# Place your code below this line

OUT = dir(tipo)
# ----------------------------------------

# group: COMPARISON OPERATORS
string_3 = StringInput("""x = IN[0] 
y = IN[1]
OUT = x == y""")
number_7 = DoubleInput(5)
number_8 = DoubleInput(5)
equal = PythonStringNode(script=string_3, IN[0]=number_7, IN[1]=number_8)  # IronPython2; frozen
string_4 = StringInput("""x = IN[0] 
y = IN[1]
OUT = x != y""")
number_9 = DoubleInput(5)
number_10 = DoubleInput(5)
not_equal = PythonStringNode(script=string_4, IN[0]=number_9, IN[1]=number_10)  # IronPython2; frozen
string_5 = StringInput("""x = IN[0] 
y = IN[1]
OUT = x > y""")
number_11 = DoubleInput(5)
number_12 = DoubleInput(5)
greater_than = PythonStringNode(script=string_5, IN[0]=number_11, IN[1]=number_12)  # IronPython2; frozen
string_6 = StringInput("""x = IN[0] 
y = IN[1]
OUT = x > y""")
number_13 = DoubleInput(5)
number_14 = DoubleInput(5)
greater_than_2 = PythonStringNode(script=string_6, IN[0]=number_13, IN[1]=number_14)  # IronPython2; frozen
string_7 = StringInput("""x = IN[0] 
y = IN[1]
OUT = x < y""")
number_15 = DoubleInput(5)
number_16 = DoubleInput(5)
less_than = PythonStringNode(script=string_7, IN[0]=number_15, IN[1]=number_16)  # IronPython2; frozen
string_8 = StringInput("""x = IN[0] 
y = IN[1]
OUT = x <= y""")
number_17 = DoubleInput(5)
number_18 = DoubleInput(5)
greater_than_or_equal_to = PythonStringNode(script=string_8, IN[0]=number_17, IN[1]=number_18)  # IronPython2; frozen
string_9 = StringInput("""x = IN[0] 
y = IN[1]
OUT = x >= y""")
number_19 = DoubleInput(5)
number_20 = DoubleInput(5)
less_than_or_equal_to = PythonStringNode(script=string_9, IN[0]=number_19, IN[1]=number_20)  # IronPython2; frozen

# group: OPERATORS
string_10 = StringInput("""x = IN[0]
y = IN[1]
OUT = x % y""")
number_21 = DoubleInput(19)
number_22 = DoubleInput(9)
MODULE = PythonStringNode(script=string_10, IN[0]=number_21, IN[1]=number_22)  # IronPython2; frozen
string_11 = StringInput("""x = IN[0]
y = IN[1]
OUT = x // y""")
number_23 = DoubleInput(19)
number_24 = DoubleInput(9)
integer_division = PythonStringNode(script=string_11, IN[0]=number_23, IN[1]=number_24)  # IronPython2; frozen

# group: Assignment Operators
string_12 = StringInput("""x = IN[0]

x *= 3

OUT = x""")
number_25 = DoubleInput(19)
# note: x = 5
# x += 3  equivalent to x = x +3
# x -= 3 equivalent to x = x - 3
# x *= 3 equivalent to x = x * 3
# x /= 3 equivalent to x = x / 3
# x %=3 equivalent to x = x % 3
# x //= 3 equivalent to x = x // 3
# x **= 3 equivalent to x = x ** 3
# x ^=3 equivalent to x = x ^ 3
assignment_operators = PythonStringNode(script=string_12, IN[0]=number_25)  # IronPython2; frozen

# group: IDENTITY OPERATORS
number_26 = DoubleInput(4)
identity_operators = Python(IN[0]=number_26)  # IronPython2; frozen
# ---------- identity_operators.python (22 lines) ----------
# Load the Python Standard and DesignScript Libraries
import sys
import clr
clr.AddReference('ProtoGeometry')
from Autodesk.DesignScript.Geometry import *

# The inputs to this node will be stored as a list in the IN variables.
x = IN[0]

y = x

# Place your code below this line
test4 = x is not y 
test1 = x is y 

list_test = [1,2,3,4,5]

test6 = x in list_test
test7 = y not in list_test

# Assign your output to the OUT variable.
OUT = test7
# ----------------------------------------

# group: LISTS
string_13 = StringInput("""thislist = [IN[0], IN[1], IN[2]]



OUT = thislist""")
string_14 = StringInput("apple")
string_15 = StringInput("banana")
string_16 = StringInput("cherry")
list = PythonStringNode(script=string_13, IN[0]=string_14, IN[1]=string_15, IN[2]=string_16)  # IronPython2; frozen
string_17 = StringInput("""thislist = [0,1,2,3,4,5,6,7,8,9,10,11,12,13,14,15,16,17]

OUT = thislist[1:18]""")
range_start_end = PythonStringNode(script=string_17)  # IronPython2; frozen
string_18 = StringInput("""thislist = [0,1,2,3,4,5,6,7,8,9,10,11,12,13,14,15,16,17]

OUT = thislist[ :2]""")
range_end = PythonStringNode(script=string_18)  # IronPython2
string_19 = StringInput("""thislist = [0,1,2,3,4,5,6,7,8,9,10,11,12,13,14,15,16,17]

OUT = thislist[ 2 :]""")
range_start = PythonStringNode(script=string_19)  # IronPython2
string_20 = StringInput("""thislist = [0,1,2,3,4,5,6,7,8,9,10,11,12,13,14,15,16,17]

OUT = thislist[ -18 : - 1]""")
range_start_end_2 = PythonStringNode(script=string_20)  # IronPython2
string_21 = StringInput("""thislist = [0,1,2,3,4,5,6,7,8,9,10,11,12,13,14,15,16,17]

thislist[4] = "car"

OUT = thislist""")
change_value = PythonStringNode(script=string_21)  # IronPython2; frozen
string_22 = StringInput("""thislist = [0,1,2,3,4,5,6,7,8,9,10,11,12,13,14,15,16,17]

newlist = []

for e in thislist:
	newlist.append( 10 +  e)

OUT = newlist""")
for_loop_iteration_in_list = PythonStringNode(script=string_22)  # IronPython2; frozen
string_23 = StringInput("""thislist = [0,1,2,3,4,5,6,7,8,9,10,11,12,13,14,15,16,17]

if 1 in thislist:
	OUT = True""")
if_value_in_list = PythonStringNode(script=string_23)  # IronPython2; frozen
string_24 = StringInput("""thislist = [0,1,2,3,4,5,6,7,8,9,10,11,12,13,14,15,16,17]

OUT = dir(thislist)""")
dir = PythonStringNode(script=string_24)  # IronPython2; frozen
string_25 = StringInput("""thislist = [0,1,2,3,4,5,6,7,8,9,10,11,12,13,14,15,16,17]

OUT = len(thislist)""")
len = PythonStringNode(script=string_25)  # IronPython2; frozen
string_26 = StringInput("""thislist =list(IN[0])

OUT = thislist""")
code_block_9 = CodeBlock { "café"; }
list_2 = PythonStringNode(script=string_26, IN[0]=code_block_9)  # IronPython2; frozen
string_27 = StringInput("""thislist =[0,1,2,"CAFÉ",4,5,6,7,8,9,10,11,12,13,14,15,16,17]

index = []

for e, i in zip(thislist, enumerate(thislist)): 
	if e == "CAFÉ":
		index.append(i)

OUT = index""")
enumerate_and_zip = PythonStringNode(script=string_27)  # IronPython2; frozen
string_28 = StringInput("""thislist =[0,1,2,"CAFÉ",4,5,6,7,8,9,10,11,12,13,14,15,16,17]

thislist.insert(4, 3)

OUT = thislist""")
insert = PythonStringNode(script=string_28)  # IronPython2; frozen
string_29 = StringInput("""thislist =[0,1,2,"CAFÉ",4,5,6,7,8,9,10,11,12,13,14,15,16,17]

thislist.remove("CAFÉ")

OUT = thislist""")
remove = PythonStringNode(script=string_29)  # IronPython2; frozen
string_30 = StringInput("""thislist =[0,1,2,"CAFÉ",4,5,6,7,8,9,10,11,12,13,14,15,16,17]

del thislist[3]

OUT = thislist""")
del_ = PythonStringNode(script=string_30)  # IronPython2; frozen
string_31 = StringInput("""thislist =[0,1,2,"CAFÉ",4,5,6,7,8,9,10,11,12,13,14,15,16,17]

otherlist = [2,3,4,5,5]

joined = thislist + otherlist

OUT = joined""")
join_2 = PythonStringNode(script=string_31)  # IronPython2; frozen
string_32 = StringInput("""thislist =[0,1,2,"CAFÉ",4,5,6,7,8,9,10,11,12,13,14,15,16,17]

newList = [2,3,4,5,5]

for x in newList:
	thislist.append(x)

OUT = thislist""")
join_by_loop = PythonStringNode(script=string_32)  # IronPython2; frozen
string_33 = StringInput("""thislist =[0,1,2,"CAFÉ",4,5,6,7,8,9,10,11,12,13,14,15,16,17]

list = [1,2,3]

thislist.extend(list)

OUT = thislist""")
extend = PythonStringNode(script=string_33)  # IronPython2; frozen
string_34 = StringInput("""thislist = IN[0]


OUT = zip(*thislist)""")
code_block_10 = CodeBlock { [[1,2], [2,3], [4,5]]; }
transpose = PythonStringNode(script=string_34, IN[0]=code_block_10)  # IronPython2; frozen
string_35 = StringInput("""thislist =[0,1,2,"CAFÉ",4,5,6,7,8,9,10,11,12,13,14,15,16,17]

newList = [2,3,4,5,5]

OUT = newList.count(5)""")
count_2 = PythonStringNode(script=string_35)  # IronPython2; frozen
string_36 = StringInput("""thislist = [0, 1, 2, "CAFÉ", 4, 5, 6, 7, 8, 9, 10, 11, 12, 13, 14, 15, 16, 17]

a = [19,20,21]

newList = thislist [ len(thislist) : ] = [a]

newList = thislist [ len(thislist) : ] = [2]

OUT = thislist""")
append_x = PythonStringNode(script=string_36)  # IronPython2; frozen
string_37 = StringInput("""thislist = [0, 1, 2, "CAFÉ", 4, 5, 6, 7, 8, 9, 10, 11, 12, 13, 14, 15, 16, 17]

thislist.insert(0, 3) #insert begining 

thislist.insert(len(thislist), 3) #insert end

OUT = thislist""")
insert_i_x = PythonStringNode(script=string_37)  # IronPython2
string_38 = StringInput("""thislist = [0, 1, 2, "CAFÉ", 4, 5, 6, 7, 8, 9, 10, 11, 12, 13, 14, 15, 16, 17]

thislist.pop(3)

OUT = thislist""")
pop = PythonStringNode(script=string_38)  # IronPython2; frozen
string_39 = StringInput("""thislist = [0, 1, 2, "CAFÉ", 4, 5, 6, 7, 8, 9, 10, 11, 12, 13, 14, 15, 16, 17]

thislist.sort() #organize, numbers and texts 

OUT = thislist""")
sort = PythonStringNode(script=string_39)  # IronPython2; frozen
string_40 = StringInput("""thislist = [0, 1, 2, "CAFÉ", 4, 5, 6, 7, 8, 9, 10, 11, 12, 13, 14, 15, 16, 17]

thislist.reverse() #organize, numbers and texts 

OUT = thislist""")
reverse = PythonStringNode(script=string_40)  # IronPython2; frozen
string_41 = StringInput("""thislist = [0, 0, 1, 2, 3, 4, 5, 1, 2, "CAFÉ", 4, 5, 6, 7, 8, 9, 10, 11, 12, 13, 14, 15, 16, 17]

OUT = sorted (set(thislist))""")
unique_item_and_sorting_set = PythonStringNode(script=string_41)  # IronPython2; frozen
string_42 = StringInput("""thislist = range(17)

OUT = thislist""")
range_stop = PythonStringNode(script=string_42)  # IronPython2; frozen
string_43 = StringInput("""thislist = range(0, 17, 1)

OUT = thislist""")
range_start_stop_step = PythonStringNode(script=string_43)  # IronPython2; frozen
string_44 = StringInput("""thislist = ["café", "cavalo", "laranja", "banana", "maçã"]

index = []
for n in range(0, len(thislist)):
	index.append(n)

OUT = index """)
map_index_of_other_list = PythonStringNode(script=string_44)  # IronPython2; frozen
string_45 = StringInput("""thislist = ["café", "cavalo", "laranja", "banana", "maçã"]

ElemIndex = [ x for x in enumerate (thislist, 1) ] 

OUT = ElemIndex""")
map_index_of_other_list_2 = PythonStringNode(script=string_45)  # "map index of other list - enumerate"; IronPython2; frozen
string_46 = StringInput("""num = [] 

for i in reversed (xrange( 1, 10 ,1)):
	num.append(i)

OUT = num""")
get_reversed_countdown = PythonStringNode(script=string_46)  # IronPython2; frozen
